# Dynamo graph big_export_test.dyn (Dynamo 2.19.3.6394)

file_path = Filename(".\walls.csv")
categories = Categories("OST_Walls")
all_elements_of_category = ElementsOfCategory(Category=categories)
id = Element.Id(element=all_elements_of_category)
string_from_object = FromObject(object=id)
getCategory = Element.GetCategory(element=all_elements_of_category)
name = Category.Name(category=getCategory)
elementType = Element.ElementType(element=all_elements_of_category)
familyName = ElementType.FamilyName(elementType=elementType)
name_2 = ElementType.Name(elementType=elementType)
getMaterials = Element.GetMaterials(element=all_elements_of_category)
string_from_array = FromArray(array=getMaterials)
boundingBox = Element.BoundingBox(element=all_elements_of_category)
string_from_object_2 = FromObject(object=boundingBox)
name_3 = Element.Name(element=all_elements_of_category)
python_script = Python(IN[0]=string_from_object, IN[1]=name, IN[2]=familyName, IN[3]=name_2, IN[4]=string_from_array, IN[5]=string_from_object_2, IN[6]=name_3)  # CPython3
# ---------- python_script.python (26 lines) ----------
# Load the Python Standard and DesignScript Libraries
import sys
import clr
clr.AddReference('ProtoGeometry')
from Autodesk.DesignScript.Geometry import *

# The inputs to this node will be stored as a list in the IN variables.
dataEnteringNode = IN

# Place your code below this line

x = ["Element.Name,Category.Name,ElementType.Name,ElementType.FamilyName"]
for i in range(len(dataEnteringNode[0])):
    #l = []
    #for j in range(0,4):
    #    l.append([dataEnteringNode[j][i]])
    l = [
        dataEnteringNode[0][i], dataEnteringNode[1][i], dataEnteringNode[2][i], dataEnteringNode[3][i],
        dataEnteringNode[4][i], dataEnteringNode[5][i], #dataEnteringNode[2][i], dataEnteringNode[3][i]
        ]
    x += [",".join(tuple(l))]

# dataEnteringNode[0][i], dataEnteringNode[1][i], dataEnteringNode[2][i], dataEnteringNode[3][i]

# Assign your output to the OUT variable.
OUT = x
# ----------------------------------------
exportCSV = Data.ExportCSV(filePath=file_path, data=python_script)
categories_2 = Categories("OST_Doors")
all_elements_of_category_2 = ElementsOfCategory(Category=categories_2)
join = List.Join()  # unwired: list0
getLocation = Element.GetLocation(element=all_elements_of_category)
uniqueId = Element.UniqueId()  # unwired: element
file_path_2 = Filename(".\params.csv")
parameters = Element.Parameters(element=all_elements_of_category)
string_from_array_2 = FromArray(array=parameters)
stringifyJSON = Data.StringifyJSON(values=string_from_array_2)
exportCSV_2 = Data.ExportCSV(filePath=file_path_2, data=stringifyJSON)
