# Dynamo graph dynamo_test.dyn (Dynamo 2.19.3.6394)

loopWhile = LoopWhile()  # unwired: initialValue, continueWhile, loopBody
categories = Categories("OST_Columns")
watch = Watch(categories)
file_path = Filename("C:\Users\lucam\Desktop\entangl\export_dynamo.csv")
levels = Levels("L4")
all_elements_at_level = ElementsAtLevel(Level=levels)
watch_2 = Watch(all_elements_at_level)
exportCSV = Data.ExportCSV(filePath=file_path, data=watch_2)
all_elements_of_class = ElementsOfType()  # unwired: element_class
element_classes = ElementTypes()  # nothing selected
