# Dynamo graph json_export.dyn (Dynamo 2.19.3.6394)

file_path = Filename(".\all.json")
categories = Categories("OST_Doors")
categories_2 = Categories("OST_Windows")
categories_3 = Categories("OST_Walls")
categories_4 = Categories("OST_DuctCurves")
categories_5 = Categories("OST_Floors")
categories_6 = Categories("OST_Ceilings")
categories_7 = Categories("OST_Furniture")
categories_8 = Categories("OST_PipeCurves")
categories_9 = Categories("OST_Roofs")
categories_10 = Categories("OST_Stairs")
categories_11 = Categories("OST_Columns")
categories_12 = Categories("OST_MEPAnalyticalAirLoop")
list_create = List.Create(item0=categories, item1=categories_2, item2=categories_3, item3=categories_4, item4=categories_5, item5=categories_6, item6=categories_7, item7=categories_8, item8=categories_9, item9=categories_10, item10=categories_11, item11=categories_12)
all_elements_of_category = ElementsOfCategory(Category=list_create)
parameters = Element.Parameters(element=all_elements_of_category)
getMaterials = Element.GetMaterials(element=all_elements_of_category)
name = Material.Name(material=getMaterials)
python_script = Python(IN[0]=parameters, IN[1]=name)  # CPython3
# ---------- python_script.python (46 lines) ----------
# Load the Python Standard and DesignScript Libraries
import sys
import clr
clr.AddReference('ProtoGeometry')
from Autodesk.DesignScript.Geometry import *

# The inputs to this node will be stored as a list in the IN variables.
dataEnteringNode = IN

# Place your code below this line
all = dataEnteringNode[0]
materials = dataEnteringNode[1]
out = 0
all = all
all_list = []
for i, cat in enumerate(all):
    cat_list = []
    for j, elem in enumerate(cat):
        #print(elem)
        #e_list = []
        e_dict = {}
        for param in elem:
            #if
            k = str(param.Name)
            v = str(param.Value)#param.AsString() #AsValueString()#str(param.Value)#Core.String.Action.StringFromObject(param.Value)
            #out = (k, v)#Name#type(param)
            #e_list += [(k, v)]
            e_dict[k] = v 
            #break
        try:
            e_dict['Materials'] = materials[i][j]
        except IndexError:
            continue

        
        #out = e_list
        #cat_list += [e_list]
        cat_list += [e_dict]
         
    all_list += [cat_list]
    
    
out = all_list
#out = dir(materials[0][0][0])#len(materials[0][0])
# Assign your output to the OUT variable.
OUT = out
# ----------------------------------------
stringifyJSON = Data.StringifyJSON(values=python_script)
exportCSV = Data.ExportCSV(filePath=file_path, data=stringifyJSON)
python_script_2 = Python()  # CPython3; unwired: IN[0]
# ---------- python_script_2.python (110 lines) ----------
# Load the Python Standard and DesignScript Libraries
import clr
import sys
sys.path.append('C:\Program Files (x86)\IronPython 2.7\Lib')
import System
from System import Array
from System.Collections.Generic import *
clr.AddReference('ProtoGeometry')
from Autodesk.DesignScript.Geometry import *
clr.AddReference("RevitNodes")
import Revit
clr.ImportExtensions(Revit.Elements)
clr.ImportExtensions(Revit.GeometryConversion)
clr.AddReference("RevitServices")
import RevitServices
from RevitServices.Persistence import DocumentManager 
from RevitServices.Transactions import TransactionManager 

clr.AddReference("RevitAPI")
clr.AddReference("RevitAPIUI")

import Autodesk 
from Autodesk.Revit.DB import *
from Autodesk.Revit.UI import *

doc = DocumentManager.Instance.CurrentDBDocument
uiapp = DocumentManager.Instance.CurrentUIApplication 
app = uiapp.Application 
uidoc = uiapp.ActiveUIDocument

# The inputs to this node will be stored as a list in the IN variables.
dataEnteringNode = IN

# Place your code below this line

#wall_collector = FilteredElementCollector(doc).OfCategory(BuiltInCategory.OST_Walls).WhereElementIsNotElementType()


#door_collector = FilteredElementCollector(doc).OfCategory(BuiltInCategory.OST_Doors).WhereElementIsNotElementType()
from Autodesk.Revit.DB import FilteredElementCollector, BuiltInCategory, ElementCategoryFilter, LogicalOrFilter

# Assume 'doc' is your Revit document

# Define the categories you want to filter
categories = [
    #BuiltInCategory.OST_Walls, 
    BuiltInCategory.OST_Doors, 
    BuiltInCategory.OST_Windows
]

# Create individual category filters
category_filters = [ElementCategoryFilter(category) for category in categories]

# Combine them into a LogicalOrFilter
combined_filter = LogicalOrFilter(category_filters)

# Use FilteredElementCollector with the combined filter
collector = FilteredElementCollector(doc).WherePasses(combined_filter).WhereElementIsNotElementType()

# Collect the elements
elements = collector.ToElements()

def get_parameter_value(param):
    if param.StorageType == StorageType.String:
        return param.AsString()
    elif param.StorageType == StorageType.Double:
        return param.AsDouble()
    elif param.StorageType == StorageType.Integer:
        return param.AsInteger()
    elif param.StorageType == StorageType.ElementId:
        return param.AsElementId()
    return None

out = []

# Print the results
for elem in elements:
    
    for param in elem.Parameters:
        param_name = param.Definition.Name
        param_value = get_parameter_value(param)
        out += [(param_name, param_value)]
        #print(f"  {param_name}: {param_value}")
        
    if hasattr(elem, "GetMaterialIds"):
        material_ids = elem.GetMaterialIds(False)  # False means physical material ids
        #print(f"  Materials:")
        materials = []
        for material_id in material_ids:
            material = doc.GetElement(material_id)
            materials += [material.Name]
            #print(f"    {material.Name}")
        out += [materials]
    OUT = out
    #print(f"Element ID: {elem.Id}, Name: {elem.Name}")
    break

#out = []
#wall_params = ['CrossSection', 'StructuralUsage', 'Width'] # Orientation
#for wall in wall_collector:
#    w = []
#    params = wall.GetOrderedParameters()#dir(wall)
#    for param in params:
#        w += [param.AsValueString()]
#    OUT = w
#    break
    #w[''

# Assign your output to the OUT variable.
#OUT = 0
# ----------------------------------------
